# Grasshopper definition visual_debugger.gh (Grasshopper 1.0.8)

# ---- group: 상훈
shapefile_path = Panel("..\input_data\AL_D194_11680_20251016.shp")
save_path = Panel("..\output_data\")
path = FilePath("/Users/gbjun7333/Documents/GitHub/parcel_layout_evaluation_analysis/output_data/")
block_eval = Python3Script(script=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, shapefile_path=shapefile_path, save_path=path)  # -> out, flatten(blocks); inputs shapefile_path: String; disabled
#   port script: Script to execute
# ---------- block_eval: Python ----------
# r: pyshp, geopandas, networkx

import sys, pathlib

def ensure_project_paths(shapefile_path_var=None):
    """
    1) 현재 GH 문서(.gh) 파일이 있는 폴더
    2) 그 폴더 하위의 흔한 소스 폴더 후보 (fx, grasshopper, src)
    3) shapefile_path 기반으로 추정한 저장소 루트

    를 순서대로 sys.path에 추가합니다.
    """
    gh_dir = None
    try:
        # ghenv는 GH Python 컴포넌트에서 자동 제공
        gh_doc = ghenv.Component.OnPingDocument()
        gh_path = gh_doc.FilePath  # 절대경로 문자열
        if gh_path:
            gh_dir = pathlib.Path(gh_path).parent
    except Exception:
        pass

    candidates = []

    if gh_dir:
        candidates.append(gh_dir)  # visual_debugger.gh 있는 폴더
        # 하위에 모듈이 따로 있을 수도 있는 구조 대응
        for sub in ("fx", "grasshopper", "src"):
            sub_path = gh_dir / sub
            if sub_path.is_dir():
                candidates.append(sub_path)

    # shapefile_path로부터 루트 추정 (선택적)
    if shapefile_path_var:
        try:
            p = pathlib.Path(str(shapefile_path_var).strip())
            if p.exists():
                # DATA/..../ file 구조라면 부모 두 단계 정도가 루트일 가능성이 큼
                for parent in p.parents[:3]:
                    if (parent / "shape_manager.py").exists():
                        candidates.append(parent)
                        break
        except Exception:
            pass

    # 중복 제거 + sys.path 등록
    added = []
    for c in candidates:
        try:
            c_resolved = str(c.resolve())
            if c_resolved not in sys.path:
                sys.path.insert(0, c_resolved)
                added.append(c_resolved)
        except Exception:
            continue

    if added:
        print("[DEBUG] added to sys.path:", added)

# GH 입력으로 들어온 shapefile_path 변수가 있다면 전달
ensure_project_paths(shapefile_path)

# 이후에야 import (경로 확보 후)
import importlib
import shape_manager, block_generator
from shape_manager import ShapefileManager
from block_generator import BlockGenerator

# (필요 시) 새로고침
# importlib.reload(shape_manager)
# importlib.reload(block_generator)

shapefile_manager = ShapefileManager()
parcels = shapefile_manager.get_parcels_from_shapes(str(shapefile_path))

block_gen = BlockGenerator()
blocks = block_gen.generate(parcels)
print(f"Loaded {len(parcels)} parcels.")
print(f"Generated {len(blocks)} blocks.")
# ---------- end block_eval ----------
list = ValueList({"Region": 0, "Shape": 1, "Road": 2, "Topo": 3}, selected="Topo")
py3 = Python3Script(Blocks=block_eval.blocks, ScoreType=list)  # -> out, Geometries, Colors, Lots; inputs Blocks: list, ScoreType: Int32
# ---------- py3: Python ----------
import clr
clr.AddReference("System.Drawing")
clr.AddReference("RhinoCommon")
import Rhino.Geometry as rg
from System.Drawing import Color
import math

# 사용자 정의 클래스
class LayoutScore:
    def __init__(self, region_score=0.0, shape_score=0.0, road_score=0.0, topo_score=0.0):
        self.region_score, self.shape_score, self.road_score, self.topo_score = region_score, shape_score, road_score, topo_score
class Block:
    pass

def create_surface_from_curve(curve, tolerance=0.01):
    if not curve or not curve.IsValid: return None
    if not curve.IsClosed:
        if not curve.MakeClosed(tolerance): return None
    simplified_curve = curve.Simplify(rg.CurveSimplifyOptions.All, tolerance, 0.1)
    if simplified_curve: curve = simplified_curve
    breps = rg.Brep.CreatePlanarBreps(curve, tolerance)
    if breps and breps.Count > 0: return breps[0]
    return None

def visualize_block_scores_quantile(blocks, score_type):
    if not blocks: return [], []

    # 🎨 흰색 → 진한 파란색 그라데이션 + 만점은 노란색
    colors = [
        Color.FromArgb(247, 251, 255),  # 1등급 (0-20%): 거의 흰색
        Color.FromArgb(198, 219, 239),  # 2등급 (20-40%): 연한 파랑
        Color.FromArgb(107, 174, 214),  # 3등급 (40-60%): 중간 파랑
        Color.FromArgb(33, 113, 181),   # 4등급 (60-80%): 파랑
        Color.FromArgb(8, 48, 107),     # 5등급 (80-100%): 진한 파랑
        Color.FromArgb(255, 215, 0),    # 만점 (1.0): 골드 (노란색)
    ]

    output_geometries = []
    output_colors = []
    
    scored_blocks = []
    perfect_score_blocks = []

    # 1. 점수 수집
    for block in blocks:
        if not (hasattr(block, 'layout_score') and block.layout_score and hasattr(block, 'region') and block.region):
            continue

        score = 0.0
        if score_type == 0: score = block.layout_score.region_score
        elif score_type == 1: score = block.layout_score.shape_score
        elif score_type == 2: score = block.layout_score.road_score
        elif score_type == 3: score = block.layout_score.topo_score
        if score is None or score < 0: continue

        surface = create_surface_from_curve(block.region)
        if not surface: continue
        
        if score >= 1.0:
            perfect_score_blocks.append({'geo': surface, 'score': score, 'block': block})
        else:
            scored_blocks.append({'geo': surface, 'score': score})

    # 2. 등분위 색상 할당
    if scored_blocks:
        scored_blocks.sort(key=lambda x: x['score'])
        count = len(scored_blocks)
        quintile_size = count / 5.0

        for i, block_data in enumerate(scored_blocks):
            quintile_index = min(int(i / quintile_size), 4)
            output_geometries.append(block_data['geo'])
            output_colors.append(colors[quintile_index])

    # 3. 만점 블록 (노란색)
    for block_data in perfect_score_blocks:
        output_geometries.append(block_data['geo'])
        output_colors.append(colors[5])
        
        block = block_data['block']
        lot_count = len(block.lots) if hasattr(block, 'lots') and block.lots else 0
        try:
            center = block.region.GetBoundingBox(True).Center
            center_str = "({:.1f}, {:.1f})".format(center.X, center.Y)
        except:
            center_str = "N/A"
        
        print("🟡 만점블록: score={:.4f}, 필지수={}, 위치={}".format(
            block_data['score'], lot_count, center_str))

    # --- 분석 결과 ---
    print("\n" + "="*60)
    print("📊 점수 분석 (ScoreType={})".format(score_type))
    print("="*60)
    print("총 블록: {}개".format(len(blocks)))
    print("만점 블록 (1.0점): {}개 [🟡 노란색]".format(len(perfect_score_blocks)))
    
    # 만점 블록 필지 분석
    if perfect_score_blocks:
        single_lot_blocks = 0
        multi_lot_blocks = 0
        no_lots_blocks = 0
        lot_counts = []
        
        for block_data in perfect_score_blocks:
            block = block_data['block']
            
            if not hasattr(block, 'lots') or block.lots is None or len(block.lots) == 0:
                no_lots_blocks += 1
            else:
                lot_count = len(block.lots)
                lot_counts.append(lot_count)
                if lot_count == 1:
                    single_lot_blocks += 1
                else:
                    multi_lot_blocks += 1
        
        print("\n만점 블록 필지 분석:")
        print("  - lots 데이터 없음: {}개".format(no_lots_blocks))
        print("  - 필지 1개: {}개".format(single_lot_blocks))
        print("  - 필지 여러개: {}개".format(multi_lot_blocks))
        if lot_counts:
            print("  - 필지수 범위: {} ~ {}개".format(min(lot_counts), max(lot_counts)))
    
    # 기초 통계 (만점 제외)
    if scored_blocks:
        scores = [b['score'] for b in scored_blocks]
        count = len(scores)
        mean = sum(scores) / count
        std_dev = math.sqrt(sum([(s - mean) ** 2 for s in scores]) / count)
        
        print("\n기초 통계 (만점 제외):")
        print("  - 블록수: {}개".format(count))
        print("  - 평균: {:.3f}".format(mean))
        print("  - 표준편차: {:.3f}".format(std_dev))
        print("  - 최소: {:.3f}".format(scores[0]))
        print("  - 최대: {:.3f}".format(scores[-1]))

        print("\n등급별 점수 구간 (흰색 → 진한 파랑):")
        quintile_size = count / 5.0
        for i in range(5):
            start_index = int(i * quintile_size)
            end_index = int((i + 1) * quintile_size) - 1 if i < 4 else count - 1
            
            start_score = scores[start_index]
            end_score = scores[end_index]
            
            color_desc = ["거의 흰색", "연한 파랑", "중간 파랑", "파랑", "진한 파랑"][i]
            print("  - {}등급 [{:>8}] {:>3}%-{:>3}%: {:.3f} ~ {:.3f}".format(
                i + 1, color_desc, i * 20, (i + 1) * 20, start_score, end_score))
    
    # 고득점 블록 체크
    if scored_blocks:
        high_score_blocks = [b for b in scored_blocks if b['score'] >= 0.85]
        if high_score_blocks:
            print("\n⚠️  0.85점 이상 고득점 블록: {}개 (진한 파랑, 만점 아님)".format(len(high_score_blocks)))
            for i, b in enumerate(high_score_blocks[:5]):
                print("     #{}: {:.4f}점".format(i+1, b['score']))
            if len(high_score_blocks) > 5:
                print("     ... 외 {}개".format(len(high_score_blocks) - 5))
    
    print("="*60 + "\n")
    
    return output_geometries, output_colors

# --- 실행 ---
if Blocks and ScoreType is not None:
    Geometries, Colors = visualize_block_scores_quantile(Blocks, ScoreType)
    Lots = []
    for block in Blocks:
        if hasattr(block, 'lots') and block.lots:
            Lots.extend([lot.region for lot in block.lots])
# ---------- end py3 ----------
geo = Geometry(py3.Lots)
preview = CustomPreview(Geometry=py3.Geometries, Material=py3.Colors)
panel = Panel(py3.out)
panel_2 = Panel(block_eval.out)

# ---- group: 동준
shapefile_path_2 = Panel("..\input_data\AL_D194_11680_20251016.shp")
path_2 = FilePath("/Users/gbjun7333/Documents/GitHub/parcel_layout_evaluation_analysis/output_data/")
block_eval_2 = Python3Script(script=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, shapefile_path=shapefile_path_2, save_path=path_2)  # -> out, flatten(blocks); inputs shapefile_path: String; disabled; same code as block_eval
list_2 = ValueList({"Region": 0, "Shape": 1, "Road": 2, "Topo": 3}, selected="Shape")
py3_2 = Python3Script(Blocks=block_eval_2.blocks, ScoreType=list_2)  # -> out, Geometries, Colors, Lots; inputs Blocks: list, ScoreType: Int32; same code as py3
geo_2 = Geometry(py3_2.Lots)
preview_2 = CustomPreview(Geometry=py3_2.Geometries, Material=py3_2.Colors)
panel_3 = Panel(py3_2.out)
panel_4 = Panel(block_eval_2.out)

# ----
path_3 = FilePath("C:\Users\bsh96\Documents\GIS_DATA\서울시_토지특성정보_고저데이터\test_lots.shp")
py3_3 = Python3Script()  # -> out, a, b, c, d
# ---------- py3_3: Python ----------
import scriptcontext as sc

block, ll, bl = sc.sticky["temp_debug"]

lots= block.lots
a= block.region
b = [lot.region for lot in lots]
c = [lot.road_adj for lot in lots]

print(bl, ll)
# ---------- end py3_3 ----------
geo_3 = Geometry(py3_3.b)
geo_4 = Geometry(py3_3.d)
geo_5 = Geometry(py3_3.a)
panel_5 = Panel(py3_3.c)
