# Grasshopper definition visual_debugger.gh (Grasshopper 1.0.8)

python_3_script = Python3Script(script=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)  # -> out, block_regions, blocks; unedited script template
number_slider = Slider(484, range=0..1048)
geo = Geometry(python_3_script.block_regions)
py3 = Python3Script(blocks=python_3_script.blocks)  # -> out, donut_blocks; inputs blocks: list
# ---------- py3: Python ----------
donut_blocks = []

for block in blocks:
    if block.is_donut:
        donut_blocks.append(block)
# ---------- end py3 ----------
py3_2 = Python3Script(blocks=py3.donut_blocks, x=Slider(3, range=0..4))  # -> out, lot_regions; inputs blocks: list, x: Int32
# ---------- py3_2: Python ----------
block = blocks[x]

lot_regions = [lot.region for lot in block.lots]
# ---------- end py3_2 ----------
panel = Panel(python_3_script.out)
boundary = BoundarySurfaces(Edges=py3_2.lot_regions)
